# Grasshopper definition VisualizeGeoInRhino.gh (Grasshopper 1.0.7)

path = FilePath("\\166.111.40.8\home\2024_MOOSASIDF_BS2025\test\dataset1\ORItopo\1112_119_222_446_1096\in.geo")
file = ReadFile(File=path, PerLineParse=True)
python = GhPythonScript(lines=file)  # -> out, faces, category, normal; inputs lines: list
# ---------- python: Python ----------
__author__ = "Lenovo"
__version__ = "2025.11.03"

import rhinoscriptsyntax as rs
import ghpythonlib.treehelpers as tree

blocks = '\n'.join(lines).split(';\n')
category, idd, normal, faces, holes = [], [], [], [], []
for blk in blocks:
    blk = blk.split('\n')
    coordinates, holeCoordinates = [], {}
    for li in blk:
        li = li.split(',')
        if li[0] == "f":
            cat = li[1]
            idd.append(li[2])
            continue
        if li[0] == "fn":
            try:
                normal.append(li[1:])
            except:
                print('******Warning: FileError, empty face normal.')
                normal.append(None)
        if li[0] == "fv":
            coor = li[1:]
            coordinates.append(coor)
            continue
        if li[0] == "fh":
            if li[1] not in holeCoordinates:
                holeCoordinates[li[1]] = []
            coor = li[2:]
            holeCoordinates[li[1]].append(list(coor))
            continue
    if len(coordinates) > 2:
        category.append(cat)
        fs = [coordinates]
        for coors in holeCoordinates.keys():
            fs.append(holeCoordinates[coors])
        faces.append(fs)


faces =  tree.list_to_tree(faces)
normal = tree.list_to_tree(normal)
# ---------- end python ----------
cluster = Cluster(L=python.faces)
item = ListItem(List=python.normal, Index=0, Wrap=True)  # -> Item, Item1, Item2
area = Area(Geometry=flatten(cluster))  # -> Area, Centroid
merge = Merge(
    Data1=ColourSwatch(SwatchColor=RGB(84, 107, 255)),
    Data2=ColourSwatch(SwatchColor=RGB(255, 196, 87)),
    Data3=ColourSwatch(SwatchColor=RGB(161, 55, 55)))
vec = VectorXYZ(XComponent=item.Item, YComponent=item.Item1, ZComponent=item.Item2)  # -> Vector, Length
avr = Average(Input=area.Centroid)
int = Integer(python.category)
dprod = DotProduct(VectorA=vec.Vector, VectorB="0,0,1", Unitize=False)
rev = Reverse(Vector=avr)
abs = Absolute(Value=dprod)
larger = LargerThan(FirstNumber=abs, SecondNumber=0.99)  # -> LargerThan, OrEqualTo
move = Move(Geometry=cluster, Motion=rev)  # -> Geometry, Transform
int_2 = Integer(flatten(larger.LargerThan))
expression = Expression(x=int, y=int_2, Expression="y+1-x")
item_2 = ListItem(List=merge, Index=expression, Wrap=True)  # -> simplify(graft(Item))
preview = CustomPreview(Geometry=simplify(move.Geometry), Material=item_2)

# ==== cluster Cluster
L = ClusterInput()
item = ListItem(List=L, Index=0, Wrap=True)  # -> Item, Item1, Item2
pt = ConstructPoint(XCoordinate=item.Item, YCoordinate=item.Item1, ZCoordinate=item.Item2)
trim = TrimTree(Tree=pt, Depth=1)
pline = PolyLine(Vertices=trim, Closed=True)
trim_2 = TrimTree(Tree=pline, Depth=1)
boundary = BoundarySurfaces(Edges=trim_2)
S = ClusterOutput(boundary)
